% Simulink data dictionary Navigation.sldd

starTracker_meas = Simulink.Bus()  % star tracker measurements bus
  timestamp: double, Unit="sec"  % measure timestamp
  quaternion: double[4 1]  % measured quaternion

Measurements = Simulink.Bus()  % Bus containing all the measurements
  starTracker: Bus: starTracker_meas